# Dynamo graph Calculo de depreciacion por ross-heidecke.dyn (Dynamo 2.13.1.3887)

costo_de_construcción_m2_usd = DoubleInput(1010)
área_de_construcción = DoubleInput(142)
coeficiente_de_depreciación = DoubleInput(8.09)
vida_probable_años = DoubleInput(60)
antigüedad_años = DoubleInput(43)
python_script = Python(IN[0]=costo_de_construcción_m2_usd, IN[1]=área_de_construcción, IN[2]=coeficiente_de_depreciación, IN[3]=vida_probable_años, IN[4]=antigüedad_años)  # CPython3
# ---------- python_script.python (30 lines) ----------
# Carga las bibliotecas de DesignScript y normas de Python.
import sys
import clr
clr.AddReference('ProtoGeometry')
from Autodesk.DesignScript.Geometry import *

# Las entradas de este nodo se almacenan como lista en las variables IN.
dataEnteringNode = IN

# Incluya el código debajo de esta línea
costo_construccion = float(IN[0])
area = float(IN[1])
coef_depreciacion = float(IN[2])
vida_probable = float(IN[3])
antiguedad = float(IN[4])

def ross_heidecke(value_as_new):
  e_factor = (100 - coef_depreciacion) / 100
  x = antiguedad
  n = vida_probable
  b = 1 - (0.5*((x/n)+(x**x/n**x)))
  return value_as_new * b * e_factor
  
def value_as_new():
   return costo_construccion * area
   
va = ross_heidecke(value_as_new())

# Asigne la salida a la variable OUT.
OUT = "Valor actual (depreciado): " + str(va) + " USD"
# ----------------------------------------
watch = Watch(python_script)
